# Grasshopper definition ErronEstrado_FSIO.gh (Grasshopper 1.0.7)
# plug-ins: Karamba, FalseStartToggle, Opossum

# ----
# Geometry Definition
bottom = Slider(0, range=-1..1)
top = Slider(0, range=-1..1)
brep = Brep(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)
cluster = Cluster_2(B=bottom, B_2=top, brep=brep)

# ----
# Settings
case_name = Panel("Default")
optimise = BooleanToggle(True)
deflection_limit_m = Panel("0.655261")
wind_speed_m_s = Panel("30")

# ----
# Cross-section
# List Settings
smallest_size = Panel("0.10")
increment = Panel("0.01")
no_of_values = Panel("50")

# ----
# User Input/Output
geometry = Brep(cluster)

# ----
# Cross-section
# Dimensions
height_m = Panel("19.75")
width_m = Panel("19.75")
thickness_m = Panel("1.0")

# ----
# Optimise!
opitmization_solver_with_surrogate_model = Opossum(fitness=num_3, gene=[bottom, top])  # "Opitmization Solver with Surrogate Models"

# ----
# Run
create_case_and_mesh = FalseStartToggle(False)
run = FalseStartToggle(False)

# ----
# Purge
meshes = BooleanToggle(False)
results = BooleanToggle(False)

# ----
# Butterfly Geometries
# Get Building Dimensions
wall = Butterfly_WallBoundary()  # -> wall_boundary; plug-in component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
brep_2 = Brep(geometry)
wires = BrepWireframe(Brep=brep_2, Density=-1)
c_script = CSharpScript(geo=geometry)  # -> out, height, maxWidth, aveWidth; inputs geo: Brep
# ---------- c_script: C# ----------
    height = GetHeight(geo);
    maxWidth = GetWidth(geo);
    aveWidth = GetAverageWidth(geo);

    Print("Height = " + String.Format("{0:0.00}", GetHeight(geo)));
    Print("Max width = " + String.Format("{0:0.00}", GetWidth(geo)));
    Print("Average width = " + String.Format("{0:0.00}", GetAverageWidth(geo)));
# ---------- c_script: C# additional code ----------
  static double GetHeight(Brep bldg)
  {
    Box bBox = new Box(bldg.GetBoundingBox(true));
    double height = bBox.Z.Length;
    return height;
  }

  static double GetWidth(Brep bldg)
  {
    Box bBox = new Box(bldg.GetBoundingBox(true));
    double width = bBox.X.Length;
    return width;
  }

  static double GetAverageWidth(Brep bldg)
  {
    BoundingBox bldgBox = bldg.GetBoundingBox(true);
    Point3d startPt = bldgBox.Min;
    Point3d endPt = bldgBox.Max;
    double interval = (endPt.Z - startPt.Z) / 20;
    Curve[] cutCrvs = Brep.CreateContourCurves(bldg, startPt, endPt, interval);

    List<double> widths = new List<double>();
    foreach (Curve crv in cutCrvs)
    {
      Box crvBox = new Box(crv.GetBoundingBox(true));
      double wid = crvBox.X.Length;
      widths.Add(wid);
    }
    double sumWidths = 0.0;

    foreach(double val in widths)
    {
      sumWidths += val;
    }

    double aveWidth = sumWidths / widths.Count;

    return aveWidth;
  }
# ---------- end c_script ----------
jagged = SettingsSpeed()
createbfgeometry = Butterfly_CreateButterflyGeometry(name="buildings", geo=flatten(brep_2), boundary=wall, refine_levels="(0, 0)", mesh_set=jagged)  # -> report, BF_geo; plug-in component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

# ----
# Wind Tunnel
number_slider = Slider(3, range=0..10)
windvector = Butterfly_WindVector(wind_speed=wind_speed_m_s, wind_direction=Point(0, 1, 0))  # -> wind_vector; plug-in component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
tunnelparams = Butterfly_WindTunnelParameters(
    windward_x=number_slider,
    top_x=Slider(2.3, range=0..10),
    sides_x=Slider(2.3, range=0..10),
    leeward_x=Slider(10, range=0..15))  # -> report, tunnel_params; plug-in component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
createcasefromtunnel = Butterfly_CreateCaseFromTunnel(
    name=case_name,
    BF_geo=flatten(createbfgeometry.BF_geo),
    wind_vector=windvector,
    ref_wind_height=10,
    landscape=6,
    tunnel_params=tunnelparams.tunnel_params,
    run=create_case_and_mesh)  # -> report, block_pts, wind_tunnel, case; plug-in component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
panel = Panel(createcasefromtunnel.wind_tunnel)
pt = Point(createcasefromtunnel.block_pts)

# ----
# Utilities
# Purge Case
purgecase = Butterfly_purgeCase(case=createcasefromtunnel.case, block_mesh=meshes, snappy_hex_mesh=meshes, results=results, post_processing=results)  # -> report; plug-in component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
panel_2 = Panel(purgecase)

# ----
# Blockage Ratio
python = GhPythonScript(WTpoints=createcasefromtunnel.block_pts, Geo=brep_2)  # -> out, BRatio; inputs WTpoints: list of Point3d, Geo: Brep
# ---------- python: Python ----------
"""Provides a scripting component.
    Inputs:
        WTpints: Corner Points from Wind Tunnel Component
        Geo: The geometry
    Output:
        BRatio: Blockage Ratio"""

__author__ = "ErronEstrado"
__version__ = "2019.01.21"

import rhinoscriptsyntax as rs
import Rhino.Geometry as rg
import math

def CreateTunnelBox(pts):
    ptStart = pts[0]
    ptEnd = pts[6]
    box = rg.BoundingBox(ptStart, ptEnd)
    return box.ToBrep()

def TunnelBoxIntersection(box, bldg):
    bBox = bldg.GetBoundingBox(False)
    BrepBox = bBox.ToBrep()
    props = rg.VolumeMassProperties.Compute(BrepBox)
    centerPt = props.Centroid
    pln = rg.Plane(centerPt, rg.Vector3d.ZAxis, rg.Vector3d.XAxis)
    result = rg.Intersect.Intersection.BrepPlane(box, pln, 0.001)[1]
    crv = rg.Curve.JoinCurves(result)
    return crv

def BuildingIntersection(bldg):
    bBox = bldg.GetBoundingBox(False)
    BrepBox = bBox.ToBrep()
    props = rg.VolumeMassProperties.Compute(BrepBox)
    centerPt = props.Centroid
    pln = rg.Plane(centerPt, rg.Vector3d.ZAxis, rg.Vector3d.XAxis)
    result = rg.Intersect.Intersection.BrepPlane(bldg, pln, 0.001)[1]
    crv = rg.Curve.JoinCurves(result)
    return crv

def ComputeBlockageRatio(tunnel, bldg):
    bldgArea = rg.AreaMassProperties.Compute(bldg).Area
    TunnelArea = rg.AreaMassProperties.Compute(tunnel).Area
    result = bldgArea/TunnelArea
    return result

TunnelBox = CreateTunnelBox(WTpoints)
TunnelCrv = TunnelBoxIntersection(TunnelBox, Geo)
BldgCrv = BuildingIntersection(Geo)

BRatio = ComputeBlockageRatio(TunnelCrv, BldgCrv)
# ---------- end python ----------
panel_3 = Panel(python.BRatio)

# ----
# Cell Size
list = ValueList({"Coarse": 0, "Medium": 1, "Fine": 2, "Super fine": 3, "XX Fine": 4}, selected="Coarse")
python_2 = GhPythonScript(geo=brep_2, quality=list)  # -> out, cellSize; inputs geo: Brep, quality: Int32
# ---------- python_2: Python ----------
"""Provides a scripting component.
    Inputs:
        _geo: The geometry
        _quality: Mesh quality
        0 = Coarse
        1 = Medium
        2 = Fine
        3 = SuperFine
        4 = XXFine
    Output:
        cellSize_: Cell size"""

__author__ = "ErronEstrado"
__version__ = "2019.01.25"

import rhinoscriptsyntax as rs
import Rhino.Geometry as rg
import math

bBox = _geo.GetBoundingBox(True)
Box = rg.Box(bBox)

dim = Box.X.Length
if Box.Y.Length < dim:
    dim = Box.Y.Length

base = 10
n = math.sqrt(2)

def quality(x):
    return{
        0 : base,
        1 : base * n,
        2 : base * n * n,
        3 : base * n * n * n,
        4 : base * n * n * n * n
    }.get(x,10)

div = quality(_quality)
size = dim / div
cellSize_ = format(size, '.2f')
# ---------- end python_2 ----------
panel_4 = Panel(python_2.cellSize)

# ----
# Velocity Vectors
number_slider_2 = Slider(50, range=0..300)
python_3 = GhPythonScript(WTpoints=createcasefromtunnel.block_pts, geo=brep_2)  # -> out, srf; inputs WTpoints: list of Point3d, geo: Brep
# ---------- python_3: Python ----------
"""Creates vertical plane to visualize velocity vectors.
    Inputs:
        _WTpoints: Corner points of wind tunnel box
        _geo: The geometry
    Output:
        srf_: The output surface"""

__author__ = "Erron Estrado"
__version__ = "2019.01.28"

import rhinoscriptsyntax as rs
import Rhino.Geometry as rg
from copy import copy
 
def CreateTunnelBox(pts):
    ptStart = pts[0]
    ptEnd = pts[6]
    box = rg.BoundingBox(ptStart, ptEnd)
    return box.ToBrep()

def GetSurface(brep, x, bldg):
    face = brep.Faces[3].ToBrep()
    srf = copy(face)
    move = rg.Vector3d(x, 0, 0)
    srf.Translate(move)
    centerPt = rg.VolumeMassProperties.Compute(bldg).Centroid
    #centerPt.X = x
    centerPt.Z = 0.0
    scalePln = rg.Plane(centerPt, rg.Vector3d.XAxis)
    scaling = rg.Transform.Scale(scalePln, 0.3, 0.6, 1)
    srf.Transform(scaling)
    return srf

def IntersectSurface(bldg, srf):
    cutter = copy(bldg)
    centerPt = rg.VolumeMassProperties.Compute(cutter).Centroid
    centerPt.Z = 0.0
    scalePln = rg.Plane(centerPt, rg.Vector3d.ZAxis)
    scaling = rg.Transform.Scale(scalePln, 1.1, 1.1, 1.01)
    cutter.Transform(scaling)
    cutSrf = srf.Split(cutter, 0.001)
    
    srfVel = cutSrf[0]
    if rg.AreaMassProperties.Compute(cutSrf[1]).Area > rg.AreaMassProperties.Compute(cutSrf[0]).Area:
        srfVel = cutSrf[1]
    return srfVel

boxBrep = CreateTunnelBox(_WTpoints)
box = rg.Box(rg.Plane.WorldXY, boxBrep)
position = box.X.Length / 2
surface = GetSurface(boxBrep, position, _geo)

srf_ = IntersectSurface(_geo, surface)
# ---------- end python_3 ----------
python_4 = GhPythonScript(WTpoints=createcasefromtunnel.block_pts, geo=brep_2, height=number_slider_2)  # -> out, srf; inputs WTpoints: list of Point3d, geo: Brep
# ---------- python_4: Python ----------
"""Creates horizontal plane to visualize velocity vectors.
    Inputs:
        _WTpoints: Corner points of wind tunnel box
        _geo: The geometry
        _height: Height to make plane
    Output:
        srf_: The output surface"""

__author__ = "Erron Estrado"
__version__ = "2019.01.28"

import rhinoscriptsyntax as rs
import Rhino.Geometry as rg
from copy import copy
 
def CreateTunnelBox(pts):
    ptStart = pts[0]
    ptEnd = pts[6]
    box = rg.BoundingBox(ptStart, ptEnd)
    return box.ToBrep()

def GetSurface(brep, z, bldg):
    face = brep.Faces[4].ToBrep()
    srf = copy(face)
    move = rg.Vector3d(0, 0, z)
    srf.Translate(move)
    centerPt = rg.VolumeMassProperties.Compute(bldg).Centroid
    centerPt.Z = z
    centerPln = rg.Plane(centerPt, rg.Vector3d.ZAxis)
    centerScale = rg.Transform.Scale(centerPln, 0.3, 0.3, 1)
    srf.Transform(centerScale)
    return srf

def IntersectSurface(bldg, srf):
    cutter = copy(bldg)
    cutSrf = srf.Split(cutter, 0.001)
    return cutSrf[0]

bldgBox = _geo.GetBoundingBox(True)
centerPt = bldgBox.Center
bldgPln = rg.Plane(centerPt, rg.Vector3d.ZAxis)

scaling = rg.Transform.Scale(bldgPln, 1.1, 1.1, 1.0)
scaledBldg = copy(_geo)
scaledBldg.Transform(scaling)

box = CreateTunnelBox(_WTpoints)
pln = GetSurface(box, _height, _geo)
srf_ = IntersectSurface(scaledBldg, pln)
# ---------- end python_4 ----------
brep_3 = Brep([python_3.srf, python_4.srf])
gentestpts = Honeybee_GenerateTestPoints(testGeometry=flatten(brep_3), gridSize="10", distBaseSrf="0.01", moveTestMesh=Toggle(False))  # -> readMe, simplify(testPoints), simplify(ptsVectors), simplify(facesArea), simplify(mesh); plug-in component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
flatten = FlattenTree(Tree=gentestpts.testPoints, Path="{0}")

# ----
# Surface Pressures
toggle = BooleanToggle(False)
getfacade = CSharpScript(geo=brep_2)  # -> out, srf; inputs geo: Brep
# ---------- getfacade: C# ----------
    BoundingBox bBox = _geo.GetBoundingBox(true);
    double height = bBox.Max.Z;
    List<Brep> surfaces = new List<Brep>();
    List<AreaMassProperties> props = new List<AreaMassProperties>();

    foreach (BrepFace face in _geo.Faces)
    {
      Brep faceSrf = face.ToBrep();
      Point3d centre = AreaMassProperties.Compute(faceSrf).Centroid;
      if (centre.Z > 0.1 && centre.Z < height - 0.1)
      {
        surfaces.Add(faceSrf);
      }
    }

    Brep[] joinedSrfs = Brep.JoinBreps(surfaces, 0.01);
    Brep facade = joinedSrfs[0];

    if (testNormal(facade, _geo))
    {
      facade.Flip();
    }


    srf_ = ExplodeBrep(facade);
# ---------- getfacade: C# additional code ----------
  static bool testNormal(Brep facade, Brep building)
  {
    // Get one face of the Brep
    Surface srf = facade.Faces[0].ToNurbsSurface();

    // Reparametrize the surface
    Interval dom = new Interval(0, 1);
    srf.SetDomain(0, dom);
    srf.SetDomain(1, dom);

    //Get point on srf and move
    Vector3d normal = srf.NormalAt(0.5, 0.5);
    Point3d pt = srf.PointAt(0.5, 0.5);
    pt += normal;

    bool inside = building.IsPointInside(pt, 0.01, false);

    return inside;

  }


  static List<Surface> ExplodeBrep(Brep geo)
  {
    List<Surface> faces = new List<Surface>();

    foreach (Surface srf in geo.Faces)
    {
      srf.ToBrep();
      faces.Add(srf);
    }
    return faces;
  }
# ---------- end getfacade ----------
gentestpts_2 = Honeybee_GenerateTestPoints(testGeometry=getfacade.srf, gridSize="2", distBaseSrf="0.5", moveTestMesh=toggle)  # -> readMe, simplify(testPoints), simplify(ptsVectors), simplify(facesArea), simplify(mesh); plug-in component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
flatten_2 = FlattenTree(Tree=gentestpts_2.mesh, Path="{0}")
flatten_3 = FlattenTree(Tree=gentestpts_2.testPoints, Path="{0}")

# ----
# Probes for Results
# Cp Sample Point
python_5 = GhPythonScript(WTpoints=createcasefromtunnel.block_pts, geo=brep_2)  # -> out, CpSamplePt; inputs WTpoints: list of Point3d, geo: Brep
# ---------- python_5: Python ----------
__author__ = "ErronEstrado"
__version__ = "2019.02.05"

import rhinoscriptsyntax as rs
import Rhino.Geometry as rg

tunnelBox = rg.BoundingBox(_WTpoints[0], _WTpoints[6]).ToBrep()
face = tunnelBox.Faces[0]
srf = face.DuplicateSurface()
centerPt = rg.AreaMassProperties.Compute(srf).Centroid

bldgBox = _geo.GetBoundingBox(True)
bldgHeight = bldgBox.Max.Z
print bldgHeight

centerPt.Z = bldgHeight
centerPt.Y += 0.01

_CpSamplePt = centerPt
# ---------- end python_5 ----------
flatten_4 = FlattenTree(Tree=python_5.CpSamplePt, Path="{0}")

# ----
# CFD Recipe
list_2 = ValueList({"kEpsilon", "kOmega", "RNGkEpsilon", "realizableKE", "kOmegaSSTAS": "kOmegaSSTSAS"}, selected="RNGkEpsilon")
panel_5 = Panel("""U
p
k
epsilon""")
residualcontrol = Butterfly_residualControl(quantities=panel_5, values="0.0001")  # -> residual_control; plug-in component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
# CFD
ras = Butterfly_RASTurbulenceModel(RAS_model=list_2, turbulence=True, print_coeffs=True)  # -> RAS; plug-in component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
steadyincomp = Butterfly_SteadyIncompressibleRecipe(turbulence_prop=ras, residual_control=residualcontrol)  # -> report, recipe; plug-in component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

# ----
# Parallelisation
panel_6 = Panel("6")
decomposepardict_scotch = Butterfly_decomposeParDictScotch(num_of_cpus=panel_6)  # -> decompose_par_dict; plug-in component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

# ----
# Meshing
wtgrading = Butterfly_windTunnelGrading(
    wind_tunnel=createcasefromtunnel.wind_tunnel,
    cell_size=python_2.cellSize,
    cell_to_cell_ratio=1.2,
    wake_offset=2,
    height_offset=5)  # -> report, grad_xyz, cell_count_xyz, cell_count_tot, preview; plug-in component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
larger_than_90_to_get_the_hard_edges = Panel("castellatedMeshControls  {resolveFeatureAngle 95;}")
blockmesh = Butterfly_blockMesh(
    case=createcasefromtunnel.case,
    grad_xyz=wtgrading.grad_xyz,
    cell_count=wtgrading.cell_count_xyz,
    overwrite=True,
    write=Toggle(True),
    run=Toggle(True))  # -> report, case; plug-in component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
snappyhexmeshdict = Butterfly_snappyHexMeshDict(
    castellated_mesh=True,
    snap=Toggle(True),
    add_layers=False,
    n_cells_btwn_levels=3,
    max_global_cells=2000000,
    expansion_ratio=Slider(1.2, range=0..10),
    final_layer_thickness=0.7,
    min_thickness=0.1,
    n_layer_iter=50,
    additional_par=larger_than_90_to_get_the_hard_edges)  # -> snappy_hex_mesh_dict; plug-in component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
snappyhexmesh = Butterfly_snappyHexMesh(
    case=blockmesh.case,
    snappy_hex_mesh_dict=snappyhexmeshdict,
    decompose_par_dict=decomposepardict_scotch,
    write=Toggle(True),
    run=Toggle(True))  # -> report, case; plug-in component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

# ----
# Check Mesh
toggle_2 = BooleanToggle(False)
chekmesh = Butterfly_chekMesh(case=snappyhexmesh.case, run=toggle_2)  # -> readMe, max, average; plug-in component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
panel_7 = Panel(chekmesh.readMe)

# ----
# Visualise Mesh
toggle_3 = BooleanToggle(True)
loadmesh = Butterfly_LoadMesh(case=snappyhexmesh.case, inner_mesh=False, load=toggle_3)  # -> mesh; plug-in component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
preview = CustomPreview(Geometry=loadmesh, Shader=ColourSwatch(SwatchColor=RGBA(255, 0, 234, 72)))

# ----
# Move Probes to BF Mesh
pt_2 = Point(flatten_3)
getbldgmesh = GetBldgMesh(geo_3=loadmesh, geo=brep_2)
createsrfs = CreateSrfs(geo=getbldgmesh, P=pt_2)
movepts = MovePts(relay=pt_2, geo=createsrfs, geo_2=brep_2)
flatten_5 = FlattenTree(Tree=movepts, Path="{0}")

# ----
# Probe Organisation
merge = Merge(Data1=flatten_5, Data2=flatten, Data3=flatten_4)
index = ItemIndex(List=merge, Item=flatten_5)
index_2 = ItemIndex(List=merge, Item=flatten_4)
index_3 = ItemIndex(List=merge, Item=flatten)

# ----
# Solution Parameters
panel_8 = Panel("2000")
panel_9 = Panel("""p
U""")
controldict = Butterfly_controlDict(start_time=0, end_time=panel_8, write_interval=100, write_compression=False, purge_write=0)  # -> control_dict; plug-in component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
probes = Butterfly_probes(points=merge, fields=panel_9)  # -> probes; plug-in component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
solutionparams = Butterfly_SolutionParameters(control_dict=controldict, probes=probes)  # -> solution_par; plug-in component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

# ----
# Solution
toggle_4 = BooleanToggle(True)
solution = Butterfly_Solution(
    case=snappyhexmesh.case,
    recipe=steadyincomp.recipe,
    decompose_par_dict=decomposepardict_scotch,
    solution_par=solutionparams,
    interval="-1",
    write=toggle_4,
    run=run)  # -> report, solution, is_running, timestep, residual_fields, residual_values, log_files; plug-in component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
panel_10 = Panel(solution.residual_fields)
panel_11 = Panel(solution.residual_values)

# ----
# Plot Residuals
panel_12 = Panel("200 to 2000")
rec = Rectangle({Plane=PlaneXY(754.8613459, 11.38960579, 0), Size=Domain2(u=-388.0761123..388.0761123, v=-87.74969419..87.74969419)})
plotresiduals = Butterfly_PlotResiduals(solution=solution.solution, rect=rec, target_res="0.0001", port=0.1, time_range=panel_12, method=0, load=Toggle(False))  # -> report, time_range, curves, port, residual_line, colors; plug-in component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
preview_2 = CustomPreview(Geometry=plotresiduals.curves, Shader=plotresiduals.colors)
panel_13 = Panel(plotresiduals.report)
crv = Curve(plotresiduals.residual_line)

# ----
# Load Probe Values
panel_14 = Panel("p")
loadprobesvalue = Butterfly_LoadProbesValue(solution=solution.solution, field=panel_14)  # -> values; plug-in component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
loadprobesvalue_2 = Butterfly_LoadProbesValue(solution=solution.solution, field="U")  # -> values; plug-in component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

# ----
# Pressures
panel_15 = Panel("7")
gradientlibrary = Ladybug_GradientLibrary(gradIndex=panel_15)  # -> customColors; plug-in component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
item = ListItem(List=loadprobesvalue, Index=index, Wrap=True)
legendpar = Ladybug_LegendParameters(customColors=flatten(gradientlibrary))  # -> legendPar; plug-in component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
presscorrect = CSharpScript(press=item, pts=flatten_5)  # -> out, newPress; inputs press: list of Double, pts: list of Point3d
# ---------- presscorrect: C# ----------
    List<Point3d> badPts = new List<Point3d>();
    List<Point3d> goodPts = new List<Point3d>();
    List<int> badInd = new List<int>();
    List<double> badVals = new List<double>();
    List<double> goodVals = new List<double>();
    List<int> goodInd = new List<int>();

    //Divide points, pressures, and indices into good and bad
    for (int i = 0; i < _press.Count; i++)
    {
      if (_press[i] < -10000.00 || _press[i] > 10000.00)
      {
        badVals.Add(_press[i]);
        badInd.Add(i);
        badPts.Add(_pts[i]);
      }
      else
      {
        goodVals.Add(_press[i]);
        goodInd.Add(i);
        goodPts.Add(_pts[i]);
      }
    }

    //Create data tree where each branch contains the indices of the 3 closest good points
    DataTree<int> closestPts = new DataTree<int>();
    int branch = 0;

    foreach (Point3d badPt in badPts)
    {
      List<int> ptArray = ClosestPoints(goodPts, badPt, 3);
      List<int> cpInFullList = new List<int>();

      for (int i = 0; i < ptArray.Count; i++)
      {
        cpInFullList.Add(goodInd[ptArray[i]]);
      }

      closestPts.AddRange(cpInFullList, new GH_Path(branch));
      branch++;
    }

    //Average and assign new pressure values
    List<double> newPressures = new List<double>(_press);

    for (int i = 0; i < badInd.Count; i++)
    {
      List<double> closestPressures = new List<double>();
      foreach (int ind in closestPts.Branch(i))
      {
        double press = _press[ind];
        closestPressures.Add(press);
      }
      double newPress = GetAverage(closestPressures);
      newPressures[badInd[i]] = newPress;

    }

    Print("Number of bad points: " + badPts.Count.ToString());

    newPress_ = newPressures;
# ---------- presscorrect: C# additional code ----------
  static double GetAverage(List<double> values)
  {
    double sum = 0;
    foreach (double val in values)
      sum += val;
    double average = sum / values.Count;
    return average;
  }

  static List<int> ClosestPoints(List<Point3d> ptCloud, Point3d testPt, int num)
  {
    List<int> closestPts = new List<int>();
    Rhino.Collections.Point3dList searchPts = new Rhino.Collections.Point3dList(ptCloud);

    for (int i = 0; i < num; i++)
    {
      Point3d cPt = Rhino.Collections.Point3dList.ClosestPointInList(searchPts, testPt);
      int cPtInd = ptCloud.IndexOf(cPt);
      closestPts.Add(cPtInd);
      searchPts.Remove(cPt);
    }

    return closestPts;
  }
# ---------- end presscorrect ----------
mjoin = MeshJoin(Meshes=flatten_2)
recolormesh = Ladybug_RecolorMesh(analysisResult=presscorrect.newPress, inputMesh=mjoin, legendPar=legendpar, analysisTitle="Pressure.", legendTitle="Pa.")  # -> readMe, newMesh, newLegend, legendBasePt, meshColors, legendColors; plug-in component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
mesh = Mesh(mjoin)
pressure = Data(presscorrect.newPress)

# ----
# Calculate Cp
P = Data(loadprobesvalue)
U = Data(loadprobesvalue_2)
item_2 = ListItem(List=P, Index=index, Wrap=True)
item_3 = ListItem(List=U, Index=index_2, Wrap=True)
item_4 = ListItem(List=P, Index=index_2, Wrap=True)
python_6 = GhPythonScript(P=item_2, Pref=item_4, Uref=item_3)  # -> out, Cp; inputs P: list, Uref: Vector3d
# ---------- python_6: Python ----------
__author__ = "ErronEstrado"
__version__ = "2019.01.27"

import rhinoscriptsyntax as rs
import Rhino.Geometry as rg

U = _Uref.Length

presCoeff = []

for p in _P:
    Cp = (p - _Pref)/(0.5*1.225*U*U)
    presCoeff.append(format(Cp, '.2f'))

Cp_ = presCoeff
# ---------- end python_6 ----------
bldg = Geometry(brep_2)
cluster_2 = Cluster(L=python_6.Cp, C=flatten_5, bldg=bldg)
panel_16 = Panel(cluster_2)

# ---- group: points
pt_3 = Point(flatten)

# ----
# Results
ladybug = Ladybug_Ladybug()  # -> Vviiiiiiiiiizzz; plug-in component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

# ----
# Pre-Processing
pressure_2 = Number(pressure)
mesh_2 = Data(mesh)

# ----
# Curve for Point Sorting
bbox = BoundingBox(Content=mesh_2, Plane=PlaneXY(0, 0, 0), UnionBox=True)  # -> Box, Box_2
debox = DeconstructBox(Box=bbox.Box)  # -> Plane, X, Y, Z
volume = Volume(Geometry=bbox.Box)  # -> Volume, Centroid
dedomain = DeconstructDomain(Domain=debox.X)  # -> Start, End
project = Project(Geometry=volume.Centroid, Plane=PlaneXY(0, 0, 0))  # -> Geometry, Transform
subtraction = Subtraction(A=dedomain.End, B=dedomain.Start)
cir = Circle(Plane=project.Geometry, Radius=subtraction)

# ----
# Pa to kN
panel_17 = Panel("1000")
face_area = CSharpScript(Mesh=mesh_2)  # -> out, Areas; inputs Mesh: Mesh
# ---------- face_area: C# ----------
    List<double> areas = new List<double>();

    foreach (MeshFace face in Mesh.Faces)
    {
      List<Point3d> pointList = new List<Point3d>();
      pointList.Add(Mesh.Vertices[face.A]);
      pointList.Add(Mesh.Vertices[face.B]);
      pointList.Add(Mesh.Vertices[face.C]);
      pointList.Add(Mesh.Vertices[face.D]);
      pointList.Add(Mesh.Vertices[face.A]);
      PolylineCurve pLine = new PolylineCurve(pointList);
      
      double area = AreaMassProperties.Compute(pLine).Area;
      areas.Add(area);
    }
    Areas = areas;
# ---------- end face_area ----------
division = Division(A=pressure_2, B=panel_17)
multiplication = Multiplication(A=division, B=face_area.Areas)

# ----
# Division Settings
vert_divisions = Slider(6, range=0..10)
hrz_divisions = Slider(8, range=0..10)

# ----
# Mesh Faces to Surfaces
c_script_2 = CSharpScript(Mesh=mesh_2)  # -> out, Faces; inputs Mesh: Mesh
# ---------- c_script_2: C# ----------
    List<NurbsSurface> surfaces = new List<NurbsSurface>();

    foreach (MeshFace face in Mesh.Faces)
    {
      NurbsSurface srf = NurbsSurface.CreateFromCorners(Mesh.Vertices[face.A], Mesh.Vertices[face.B], Mesh.Vertices[face.C], Mesh.Vertices[face.D]);
      surfaces.Add(srf);
    }
    Faces = surfaces;
# ---------- end c_script_2 ----------

# ----
# Mesh Face
# Centres and Normals
facen = FaceNormals(Mesh=mesh_2)  # -> Centers, Normals

# ----
# Points
pdecon = Deconstruct(Point=facen.Centers)  # -> XComponent, YComponent, ZComponent
cset = CreateSet(List=pdecon.ZComponent)  # -> Set, Map
mindex = MemberIndex(Set=pdecon.ZComponent, Member=cset.Set)  # -> Index, Count
item_5 = ListItem(List=facen.Centers, Index=mindex.Index, Wrap=True)  # -> simplify(Item)
alongcrv = SortAlongCurve(Points=item_5, Curve=flatten(cir))  # -> Points, Indices

# ----
# Normals
item_6 = ListItem(List=facen.Normals, Index=mindex.Index, Wrap=True)
item_7 = ListItem(List=item_6, Index=alongcrv.Indices, Wrap=True)

# ----
# Loads
item_8 = ListItem(List=multiplication, Index=mindex.Index, Wrap=True)
item_9 = ListItem(List=item_8, Index=alongcrv.Indices, Wrap=True)

# ----
# Group and Sort
# Faces
item_10 = ListItem(List=c_script_2.Faces, Index=mindex.Index, Wrap=True)
item_11 = ListItem(List=item_10, Index=alongcrv.Indices, Wrap=True)

# ----
# Get Horizontal
# Division Count
lng = ListLength(List=alongcrv.Points)
item_12 = ListItem(List=flatten(lng), Index=0, Wrap=True)
division_2 = Division(A=item_12, B=hrz_divisions)

# ----
# Create Load Vectors
rev = Reverse(Vector=item_7)
# Group and sum
# Horizontal
amp = Amplitude(Vector=rev, Amplitude=item_9)

# ----
# Get Centre Points
avr = Average(Input=alongcrv.Points)

# ----
# Faces
partition = PartitionList(List=simplify(item_11), Size=division_2)
# FSI COUPLING
join = BrepJoin(Breps=partition)  # -> Breps, Closed

# ----
# Load Vectors
partition_2 = PartitionList(List=simplify(amp), Size=division_2)
ma = MassAddition(Input=partition_2)  # -> Result, PartialResults

# ----
# Face Points
partition_3 = PartitionList(List=simplify(alongcrv.Points), Size=division_2)
avr_2 = Average(Input=partition_3)

# ----
# Load Vectors
vgrouping = CSharpScript(tree=ma.Result, zDiv=vert_divisions)  # -> out, newTree; inputs tree: tree, zDiv: Int32
# ---------- vgrouping: C# ----------
    IList<GH_Path> paths = tree.Paths;
    GH_Path lastBranch = paths[paths.Count - 1];
    int lenZ = lastBranch.Indices[0];
    int lenX = lastBranch.Indices[1];

    int zGrouping = (lenZ + 1) / zDiv;

    newTree = Grouping(tree, lenX, lenZ, zGrouping);
# ---------- vgrouping: C# additional code ----------
  public DataTree<object> Grouping(DataTree<object> input, int xDim, int yDim, int grouping)
  {
    DataTree<object> grouped = new DataTree<object>();

    for (int i = 0; i <= xDim; i++)
    {
      int ind = 0;
      int counter = 0;

      for (int j = 0; j <= yDim; j++)
      {
        int[] getPath = {j, i};
        int[] setPath = {ind, i};
        object item = input.Branch(new GH_Path(getPath))[0];
        grouped.Add(item, new GH_Path(setPath));
        counter++;
        if (counter > grouping)
        {
          ind++;
          counter = 0;
        }
      }
    }
    return grouped;
  }


  //Return a BoundingBox that contains all the geometry you are about to draw.
  public override BoundingBox ClippingBox
  {
    get
    {
      return BoundingBox.Empty;
    }
  }

  //Draw all meshes in this method.
  public override void DrawViewportMeshes(IGH_PreviewArgs args)
  {
  }

  //Draw all wires and points in this method.
  public override void DrawViewportWires(IGH_PreviewArgs args)
  {
  }
# ---------- end vgrouping ----------

# ----
# Face Points
vgrouping_2 = CSharpScript(tree=avr_2, zDiv=vert_divisions)  # -> out, newTree; inputs tree: tree, zDiv: Int32
# ---------- vgrouping_2: C# ----------
    IList<GH_Path> paths = tree.Paths;
    GH_Path lastBranch = paths[paths.Count - 1];
    int lenZ = lastBranch.Indices[0];
    int lenX = lastBranch.Indices[1];

    int zGrouping = (lenZ + 1) / zDiv;

    newTree = Grouping(tree, lenX, lenZ, zGrouping);
# ---------- vgrouping_2: C# additional code ----------
  public DataTree<object> Grouping(DataTree<object> input, int xDim, int yDim, int grouping)
  {
    DataTree<object> grouped = new DataTree<object>();

    for (int i = 0; i <= xDim; i++)
    {
      int ind = 0;
      int counter = 0;

      for (int j = 0; j <= yDim; j++)
      {
        int[] getPath = {j, i};
        int[] setPath = {ind, i};
        object item = input.Branch(new GH_Path(getPath))[0];
        grouped.Add(item, new GH_Path(setPath));
        counter++;
        if (counter > grouping)
        {
          ind++;
          counter = 0;
        }
      }
    }
    return grouped;
  }
# ---------- end vgrouping_2 ----------

# ----
# Group and sum
# Vertical
# Faces
vgrouping_3 = CSharpScript(tree=join.Breps, zDiv=vert_divisions)  # -> out, newTree; inputs tree: tree, zDiv: Int32; same code as vgrouping

# ----
# Geometry Division
join_2 = BrepJoin(Breps=vgrouping_3.newTree)  # -> Breps, Closed
edges = BrepEdges(Brep=join_2.Breps)  # -> Naked, Interior, NonManifold
crv_2 = Curve(edges.Naked)

# ----
# Make Cross-section List
panel_18 = Panel("core_")
series = Series(Start=smallest_size, Step=increment, Count=no_of_values)
concat = Concatenate(FragmentA=panel_18, FragmentB=series)
bnd = Bounds(Numbers=series)

# ----
# Material
matselect = MaterialSelectionKaramba3D(menu=[dropdown(3), dropdown(9)])

# ----
# Results
cs_thickness_list_m = Panel(bnd)
building_dimensions_m = Panel(c_script.out)

# ----
# Velocity Vectors
item_13 = ListItem(List=loadprobesvalue_2, Index=index_3, Wrap=True)
scale = Slider(0.1, range=0..1)

# ---- group: vectors
vec = Vector(item_13)

# ----
vlen = VectorLength(Vector=vec)
c_script_3 = CSharpScript(press=vlen, pts=pt_3)  # -> out, newPress; inputs press: list of Double, pts: list of Point3d
# ---------- c_script_3: C# ----------
    List<Point3d> badPts = new List<Point3d>();
    List<Point3d> goodPts = new List<Point3d>();
    List<int> badInd = new List<int>();
    List<double> badVals = new List<double>();
    List<double> goodVals = new List<double>();
    List<int> goodInd = new List<int>();

    //Divide points, pressures, and indices into good and bad
    for (int i = 0; i < _press.Count; i++)
    {
      if (_press[i] < -10000.00 || _press[i] > 10000.00)
      {
        badVals.Add(_press[i]);
        badInd.Add(i);
        badPts.Add(_pts[i]);
      }
      else
      {
        goodVals.Add(_press[i]);
        goodInd.Add(i);
        goodPts.Add(_pts[i]);
      }
    }

    //Create data tree where each branch contains the indices of the 3 closest good points
    DataTree<int> closestPts = new DataTree<int>();
    int branch = 0;

    foreach (Point3d badPt in badPts)
    {
      List<int> ptArray = ClosestPoints(goodPts, badPt, 3);
      List<int> cpInFullList = new List<int>();

      for (int i = 0; i < ptArray.Count; i++)
      {
        cpInFullList.Add(goodInd[ptArray[i]]);
      }

      closestPts.AddRange(cpInFullList, new GH_Path(branch));
      branch++;
    }

    //Average and assign new pressure values
    List<double> newPressures = new List<double>(_press);

    for (int i = 0; i < badInd.Count; i++)
    {
      List<double> closestPressures = new List<double>();
      foreach (int ind in closestPts.Branch(i))
      {
        double press = _press[ind];
        closestPressures.Add(press);
      }
      double newPress = GetAverage(closestPressures);
      newPressures[badInd[i]] = newPress;

    }
    
    Print("Number of bad points: " + badPts.Count.ToString());

    newPress_ = newPressures;
# ---------- c_script_3: C# additional code ----------
  static double GetAverage(List<double> values)
  {
    double sum = 0;
    foreach (double val in values)
      sum += val;
    double average = sum / values.Count;
    return average;
  }

  static List<int> ClosestPoints(List<Point3d> ptCloud, Point3d testPt, int num)
  {
    List<int> closestPts = new List<int>();
    Rhino.Collections.Point3dList searchPts = new Rhino.Collections.Point3dList(ptCloud);

    for (int i = 0; i < num; i++)
    {
      Point3d cPt = Rhino.Collections.Point3dList.ClosestPointInList(searchPts, testPt);
      int cPtInd = ptCloud.IndexOf(cPt);
      closestPts.Add(cPtInd);
      searchPts.Remove(cPt);
    }

    return closestPts;
  }
# ---------- end c_script_3 ----------
bnd_2 = Bounds(Numbers=c_script_3.newPress)
dedomain_2 = DeconstructDomain(Domain=bnd_2)  # -> Start, End
gradient = Gradient(
    LowerLimit=dedomain_2.End,
    UpperLimit=dedomain_2.Start,
    Parameter=c_script_3.newPress,
    stops=[0: RGB(234, 38, 0), 0.25: RGB(234, 126, 0), 0.5: RGB(254, 244, 84), 0.75: RGB(173, 203, 249), 1: RGB(75, 107, 169)])
multiplication_2 = Multiplication(A=vec, B=scale)
vdisex = VectorDisplayEx(Point=pt_3, Vector=multiplication_2, Colour=gradient, Width=Slider(2, range=0..5))

# ----
# Get Point Load Vectors
ma_2 = MassAddition(Input=amp)  # -> Result, PartialResults
lng_2 = ListLength(List=flatten(ma_2.Result))
division_3 = Division(A=lng_2, B=vert_divisions)

round = Round(Number=division_3)  # -> Nearest, Floor, Ceiling

partition_4 = PartitionList(List=flatten(ma_2.Result), Size=round.Ceiling)
# Get Force and Moment Vectors
ma_3 = MassAddition(Input=partition_4)  # -> Result, PartialResults

# ----
# Get Points for
# Point Load Vectors
partition_5 = PartitionList(List=flatten(avr), Size=round.Ceiling)
avr_3 = Average(Input=partition_5)

# ----
# Point Load Vectors
number_slider_3 = Slider(1, range=0..1)
multiplication_3 = Multiplication(A=ma_3.Result, B=number_slider_3)
vdisex_2 = VectorDisplayEx(Point=avr_3, Vector=multiplication_3, Colour=ColourSwatch(SwatchColor=RGB(255, 0, 255)), Width=2)

# ----
# Create Moment Vectors
avr_4 = Average(Input=vgrouping_2.newTree)
ma_4 = MassAddition(Input=vgrouping.newTree)  # -> Result, PartialResults
pshift = ShiftPaths(Data=ma_4.Result, Offset=-1)
pshift_2 = ShiftPaths(Data=avr_4, Offset=-1)
simplify = SimplifyTree(Tree=avr_3, Front=False)
vec2pt = Vector2Pt(PointA=simplify, PointB=pshift_2, Unitize=False)  # -> Vector, Length
xprod = CrossProduct(VectorA=pshift, VectorB=vec2pt.Vector, Unitize=False)  # -> Vector, Length
ma_5 = MassAddition(Input=xprod.Vector)  # -> Result, PartialResults

# ----
# Moment Vectors
number_slider_4 = Slider(0.5, range=0..1)
# Visualise
multiplication_4 = Multiplication(A=ma_5.Result, B=number_slider_4)
vdisex_3 = VectorDisplayEx(Point=avr_3, Vector=multiplication_4, Colour=ColourSwatch(SwatchColor=RGB(0, 255, 255)), Width=2)

# ----
# Get Element Line and Support Points
item_14 = ListItem(List=flatten(avr), Index=0, Wrap=True)  # -> Item1, Item
merge_2 = Merge(Data1=item_14.Item, Data2=flatten(avr_3), Data3=item_14.Item1)
rdpoints = RemoveDuplicatePointsKaramba3D(Point=merge_2, LimitDistance=0.005)  # -> OutPoint, Info, Indexes
sort = SortList(Keys=rdpoints.OutPoint, ValuesA=rdpoints.OutPoint)  # -> Keys, ValuesA
pline = PolyLine(Vertices=sort.ValuesA, Closed=False)
dash = DashPattern(Curve=pline, Pattern="8")  # -> Dashes, Gaps
explode = Explode(Curve=pline, Recursive=True)  # -> Segments, Vertices
item_15 = ListItem(List=sort.ValuesA, Index=0, Wrap=True)

# ----
# Dimensions
number_slider_5 = Slider(8, range=0..20)
shift = ShiftList(List=rdpoints.OutPoint, Shift=1, Wrap=False)
yz = YZPlane(Origin=item_14.Item)
aligndim = AlignedDimension(
    Plane=yz,
    PointA=rdpoints.OutPoint,
    PointB=shift,
    Offset=number_slider_5,
    Text="{0:0.00}",
    Size=Slider(1.47, range=1..10))

# ----
# Project Vectors
moments = Vector(ma_5.Result)
forces = Vector(ma_3.Result)
devec = DeconstructVector(Vector=forces)  # -> XComponent, YComponent, ZComponent
devec_2 = DeconstructVector(Vector=moments)  # -> XComponent, YComponent, ZComponent
vec_2 = VectorXYZ(XComponent=0, YComponent=devec.YComponent, ZComponent=0)  # -> Vector, Length
vec_3 = VectorXYZ(XComponent=0, YComponent=0, ZComponent=devec_2.ZComponent)  # -> Vector, Length

# ----
# Pre-processing
points = Point(avr_3)

# ----
# Supports
supp = SupportKaramba3D(PosInd=item_15, menu=[buttons(on, on, on, on, on, on)])

# ----
# Loads
loads = LoadsKaramba3D(
    ForceVector=flatten(vec_2.Vector),
    MomentVector=flatten(vec_3.Vector),
    Local=False,
    PosInd=flatten(points),
    LCase=0,
    mode="Point")

# ----
# Original Cross-section
num = Number(thickness_m)
concat_2 = Concatenate(FragmentA=panel_18, FragmentB=num)
multiplication_5 = Multiplication(A=height_m, B=100)
multiplication_6 = Multiplication(A=width_m, B=100)
multiplication_7 = Multiplication(A=num, B=100)

# ----
# Elements
panel_19 = Panel("core")
Y = UnitY(Factor=1)

# ----
# Cross-section List
multiplication_8 = Multiplication(A=height_m, B=100)
multiplication_9 = Multiplication(A=width_m, B=100)
multiplication_10 = Multiplication(A=series, B=100)
cross_section = CrossSectionKaramba3D(
    FamilyNameOfCrossSection="DefaultCroSec",
    NameOfCrossSection=concat,
    ElementIdentifier=panel_19,
    Material=matselect,
    Height_cm=multiplication_8,
    UpperFlangeWidth_cm=multiplication_9,
    LowerFlangeWidth_cm=multiplication_9,
    UpperFlangeThickness_cm=multiplication_10,
    LowerFlangeThickness_cm=multiplication_10,
    SidewallsThickness_cm=multiplication_10,
    FilletRadius_cm=0.6,
    mode="Box")

cross_section_2 = CrossSectionKaramba3D(
    FamilyNameOfCrossSection="DefaultCroSec",
    NameOfCrossSection=concat_2,
    ElementIdentifier=panel_19,
    Material=matselect,
    Height_cm=multiplication_5,
    UpperFlangeWidth_cm=multiplication_6,
    LowerFlangeWidth_cm=multiplication_6,
    UpperFlangeThickness_cm=multiplication_7,
    LowerFlangeThickness_cm=multiplication_7,
    SidewallsThickness_cm=multiplication_7,
    FilletRadius_cm=0.6,
    mode="Box")

linetobeam = LineToBeamKaramba3D(Line=explode.Segments, Identifier=panel_19, CrossSection=cross_section_2, New=True, Remove=True, LimitDistance_m=0.005)  # -> Element, Points, Info
# Create FEM
orientate = OrientateElemKaramba3D(Beam=linetobeam.Element, ZOrientation=Y, mode="Beam")

# ----
# Assemble
assemble = AssembleModelKaramba3D(Elem=orientate, Support=supp, Load=loads, Material=matselect, LimitDistance_m=0.005)  # -> Model, Info, Mass_kg, CenterOfGravity
division_4 = Division(A=assemble.Mass_kg, B=1000)

# ----
# FEA
# Analyse
analyze = AnalyzeKaramba3D(Model=assemble.Model)  # -> CalculatedModel, MaximumDisplacement_cm, ResultingForceOfGravity_kN, ElasticEnergy_kNm
# Solution
division_5 = Division(A=analyze.MaximumDisplacement_cm, B=100)

# ----
# Cross-section
# Optimisation
multiplication_11 = Multiplication(A=deflection_limit_m, B=100)
opticrosec = OptimizeCrossSectionKaramba3D(
    Model=assemble.Model,
    GroupIdentifiers=panel_19,
    CrossSections=cross_section,
    MaximumUtilization=1,
    MaximumDisplacement_cm=multiplication_11,
    UltimateLimitStateIterations=5,
    DisplacementIterations="10",
    NumberOfSamplePoints=3,
    ElasticDesign=True,
    GammaM0=1,
    GammaM1=1)  # -> ModelWithOptimizedCrossSections, Info, Mass_kg, MaximumDisplacement_cm, ElasticEnergy_kNm
division_6 = Division(A=opticrosec.Mass_kg, B=1000)
division_7 = Division(A=opticrosec.MaximumDisplacement_cm, B=100)

# ----
# Analyse/Optimise
# Filter
bool = Boolean(optimise)
filter = StreamFilter(Gate=bool, Stream0=division_5, Stream1=division_7)
filter_2 = StreamFilter(Gate=bool, Stream0=division_4, Stream1=division_6)
filter_3 = StreamFilter(Gate=bool, Stream0=analyze.CalculatedModel, Stream1=opticrosec.ModelWithOptimizedCrossSections)

# ----
# Results
cluster_3 = KarambaColours()
modelview = ModelViewKaramba3D(
    Model=filter_3,
    LoadCaseFactorsForLinearSuperposition=1,
    IndexOfVisibleLoadcase=-1,
    ListOfColorsForColoringPlots=cluster_3)  # -> Model, DeformedMesh, DeformedAxes, DeformedModel
beamview = BeamViewKaramba3D(Model=modelview.Model)  # -> Model, MeshesOfRenderedBeams, DeformedBeamAxes, LegendColors, LegendTags
legend = Legend(Colour=beamview.LegendColors, Tags=beamview.LegendTags, LegendType=1)

# ----
# Cross-section Details
disassemble = DisassembleModelKaramba3D(Model=filter_3)  # -> Model, Point, Beam, Shell, Support, Load, Line, Mesh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
item_16 = ListItem(List=disassemble.Beam, Index=0, Wrap=True)
disassemble_2 = DisassembleElementKaramba3D(Model=disassemble.Model, Element=item_16)  # -> Element, ElementIdentifier, AxisOfElement, CrossSection, Joints, Material, LocalCoordinateSystem, ElementIsActive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
disassemble_3 = DisassembleCrossSectionKaramba3D(CroSec=disassemble_2.CrossSection)  # -> CrossSection, FamilyNameOfCrossSection, TypeNameOfCrossSection, ElemIdentifiers, Color, Material, LocalEccentricity_cm, Heights_cm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
division_8 = Division(A=disassemble_3.Iyy_cm4, B=100000000)

num_2 = Number(filter)
num_3 = Number(filter_2)
num_4 = Number(division_8)
deflection_m = Panel(num_2)
mass_of_material_t = Panel(num_3)
moment_of_inertia_m4 = Panel(num_4)
chosen_cross_section = Panel(disassemble_3.TypeNameOfCrossSection)

# ==== cluster KarambaColours: COntains legend colours for karamba
panel = Panel("""255
255
255
175
0
0
0""")
panel_2 = Panel("""0
0
255
255
255
0
0""")
rgb = ColourRGB(Alpha=255, Red=panel, Green=panel_2, Blue=reverse(panel))
C = ClusterOutput(rgb)

# ==== cluster Cluster
C = ClusterInput()
L = ClusterInput()
bldg = ClusterInput()
bldg_2 = Geometry(bldg)
bbox = BoundingBox(Content=bldg_2, Plane=PlaneXY(0, 0, 0), UnionBox=True)  # -> Box, Box_2
debrep = DeconstructBrep(Brep=bbox.Box)  # -> Faces, Edges, Vertices
panel = Panel("""0
2""")
item = ListItem(List=debrep.Faces, Index=panel, Wrap=True)
panel_2 = Panel("""{0,1,0}
{0,-1,0}""")
sdivide = DivideSurface(Surface=item, UCount=Slider(4, range=0..10), VCount=Slider(6, range=0..10))  # -> Points, Normals, Parameters
pshift = ShiftPaths(Data=sdivide.Points, Offset=-1)  # -> simplify(Data)
project = ProjectPoint(Point=pshift, Direction=graft(panel_2), Geometry=bldg_2)  # -> Point, Index
clean = CleanTree(RemoveNulls=True, RemoveInvalid=True, RemoveEmpty=False, Tree=project.Point)
cp = ClosestPoint(Point=flatten(clean), Cloud=C)  # -> ClosestPoint, CPIndex, Distance
brep_cp = BrepClosestPoint(Point=cp.ClosestPoint, Brep=bldg_2)  # -> Point, Normal, Distance
devec = DeconstructVector(Vector=brep_cp.Normal)  # -> XComponent, YComponent, ZComponent
item_2 = ListItem(List=L, Index=cp.CPIndex, Wrap=True)
multiplication = Multiplication(A=devec.YComponent, B=Slider(1.833, range=0..2))
vec = VectorXYZ(XComponent=0, YComponent=multiplication, ZComponent="0.5")  # -> Vector, Length
cp_2 = ClusterOutput(item_2)
points = PointList(Points=cp.ClosestPoint, Size=Slider(5, range=0..10))
move = Move(Geometry=cp.ClosestPoint, Motion=vec.Vector)  # -> Geometry, Transform
xz = XZPlane(Origin=move.Geometry)
tag = TextTag3D(Location=xz, Text=item_2, Size=Slider(1, range=0..1), Justification=8)

# ==== cluster GetBldgMesh
geo = ClusterInput()
geo_2 = Geometry(geo)
bbox = BoundingBox(Content=geo_2, Plane=PlaneXY(0, 0, 0), UnionBox=True)  # -> Box, Box_2
volume = Volume(Geometry=bbox.Box)  # -> Volume, Centroid
scale = Scale(Geometry=bbox.Box, Center=volume.Centroid, Factor="1.05")  # -> Geometry, Transform
geo_3 = ClusterInput()
geo_4 = Geometry(geo_3)
disc = Discontinuity(Curve=geo_4, Level=1)  # -> Points, Parameters
pdecon = Deconstruct(Point=disc.Points)  # -> XComponent, YComponent, ZComponent
brepinc = PointInBrep(Brep=scale.Geometry, Point=disc.Points, Strict=False)
smaller = SmallerThan(FirstNumber=pdecon.ZComponent, SecondNumber="2")  # -> SmallerThan, OrEqualTo
ma = MassAddition(Input=brepinc)  # -> Result, PartialResults
lng = ListLength(List=pdecon.ZComponent)
ma_2 = MassAddition(Input=smaller.SmallerThan)  # -> Result, PartialResults
bool = Boolean(flatten(ma.Result))
equals = Equality(FirstNumber=lng, SecondNumber=ma_2.Result)  # -> Equality, Inequality
flatten = FlattenTree(Tree=equals.Inequality, Path="{0}")
and = GateAnd(A=bool, B=flatten)
cull = CullPattern(List=geo_4, CullPattern=and)
L = ClusterOutput(cull)

# ==== cluster MovePts
geo = ClusterInput()
geo_2 = ClusterInput()
relay = ClusterInput()
geo_3 = Geometry(geo)
geo_4 = Geometry(geo_2)
srf_cp = SurfaceClosestPoint(Point=relay, Surface=geo_3)  # -> Point, UVPoint, Distance
pt = Point(relay)
vec2pt = Vector2Pt(PointA=relay, PointB=srf_cp.Point, Unitize=False)  # -> Vector, Length
c_script = CSharpScript(geo=geo_4, srfs=geo_3, uv=srf_cp.UVPoint)  # -> out, V; inputs geo: Brep, srfs: list of Surface, uv: list of Point3d
# ---------- c_script: C# ----------
    List<Vector3d> normals = new List<Vector3d>();
    List<Point3d> srfPts = new List<Point3d>();
    List<Vector3d> flippedNormals = new List<Vector3d>();

    // Get Normals
    for (int i = 0; i < _srfs.Count; i++)
    {
      Vector3d normal = _srfs[i].NormalAt(_uv[i].X, _uv[i].Y);
      normals.Add(normal);
    }

    // Get Surface points
    for (int i = 0; i < _srfs.Count; i++)
    {
      Point3d srfPt = _srfs[i].PointAt(_uv[i].X, _uv[i].Y);
      srfPts.Add(srfPt);
    }

    //Flip Normals
    Box bBox = new Box(_geo.GetBoundingBox(true));
    double width = bBox.X.Length;

    for (int i = 0; i < srfPts.Count; i++)
    {
      Vector3d vec = normals[i] * (width * 0.1);
      srfPts[i] += vec;

      if (_geo.IsPointInside(srfPts[i], 0.01, true))
      {

        Vector3d flipped = Vector3d.Negate(normals[i]);
        flippedNormals.Add(flipped);
      }
      else
      {
        flippedNormals.Add(normals[i]);
      }
    }

    V = flippedNormals;
# ---------- end c_script ----------
move = Move(Geometry=relay, Motion=vec2pt.Vector)  # -> Geometry, Transform
amp = Amplitude(Vector=c_script.V, Amplitude=Slider(0.5, range=0..3))
devec = DeconstructVector(Vector=amp)  # -> XComponent, YComponent, ZComponent
vec = VectorXYZ(XComponent=devec.XComponent, YComponent=devec.YComponent, ZComponent=0)  # -> Vector, Length
move_2 = Move(Geometry=move.Geometry, Motion=vec.Vector)  # -> Geometry, Transform
G = ClusterOutput(move_2.Geometry)

# ==== cluster CreateSrfs
geo = ClusterInput()
geo_2 = Geometry(geo)
disc = Discontinuity(Curve=geo_2, Level=1)  # -> Points, Parameters
patch = Patch(Points=disc.Points, Spans=Slider(2, range=0..10), Flexibility=1, Trim=True)
md_slider = MDSlider(SliderMode=0, slider_value=Point(0.5, 0.5, 0.5), x_domain=Domain(0, 1), y_domain=Domain(0, 1), z_domain=Domain(0, 1))
flatten = FlattenTree(Tree=patch, Path="{0}")
evalsrf = EvaluateSurface(Surface=reparameterize(flatten), Point=md_slider)  # -> Point, Normal, UDirection, VDirection, Frame
amp = Amplitude(Vector=evalsrf.Normal, Amplitude=Slider(5, range=0..10))
devec = DeconstructVector(Vector=amp)  # -> XComponent, YComponent, ZComponent
vec = VectorXYZ(XComponent=devec.XComponent, YComponent=devec.YComponent, ZComponent=0)  # -> Vector, Length
angle = Angle(VectorA=amp, VectorB=vec.Vector)  # -> Angle, Reflex
deg = Degrees(Radians=angle.Angle)
smaller = SmallerThan(FirstNumber=deg, SecondNumber="5.000")  # -> SmallerThan, OrEqualTo
cull = CullPattern(List=flatten, CullPattern=smaller.SmallerThan)
P = ClusterInput()
evalsrf_2 = EvaluateSurface(Surface=reparameterize(cull), Point="{0.5,0.5,0}")  # -> Point, Normal, UDirection, VDirection, Frame
cp = ClosestPoint(Point=P, Cloud=evalsrf_2.Point)  # -> ClosestPoint, CPIndex, Distance
item = ListItem(List=cull, Index=cp.CPIndex, Wrap=True)
srfs = ClusterOutput(item)

# ==== cluster Cluster_2
brep = ClusterInput()
brep_2 = Brep(brep)
bbox = BoundingBox(Content=brep_2, Plane=PlaneXY(0, 0, 0), UnionBox=True)  # -> Box, Box_2
debox = DeconstructBox(Box=bbox.Box)  # -> Plane, X, Y, Z
num = Number(debox.Z)
division = Division(A=num, B=Slider(32, range=0..100))
contour = Contour(Shape=brep_2, Point=Point(0, 0, 0), Direction=Vector(0, 0, 1), Distance=division)
debrep = DeconstructBrep(Brep=brep_2)  # -> Faces, Edges, Vertices
item = ListItem(List=debrep.Edges, Index=1, Wrap=True)
merge = Merge(Data1=flatten(contour), Data2=flatten(item))
flip = FlipCurve(Curve=merge, Guide=item)  # -> Curve, Flag
area = Area(Geometry=flip.Curve)  # -> Area, Centroid
cp = ControlPoints(Curve=flip.Curve)  # -> Points, Weights, Knots
graft = GraftTree(Tree=area.Centroid, IncludeEmptyLists=True, IncludeNullItems=True)
dist = Distance(PointA=graft, PointB=cp.Points)
sort = SortList(Keys=dist)  # -> Keys, ValuesA
item_2 = ListItem(List=reverse(sort.Keys), Index=0, Wrap=True)
cir = Circle(Plane=graft, Radius=item_2)
crv_cp = CurveClosestPoint(Point=cp.Points, Curve=cir)  # -> Point, Parameter, Distance
series = Series(Start=0, Step=1, Count="16")
path = ConstructPath(Indices=graft(series))
vec2pt = Vector2Pt(PointA=cp.Points, PointB=crv_cp.Point, Unitize=False)  # -> Vector, Length
split = SplitTree(Data=simplify(vec2pt.Vector), Masks=flatten(path))  # -> Positive, Negative
B = ClusterInput()
B_2 = ClusterInput()
rev = Reverse(Vector=split.Negative)
multiplication = Multiplication(A=split.Positive, B=B)
multiplication_2 = Multiplication(A=rev, B=B_2)
move = Move(Geometry=cp.Points, Motion=[multiplication, multiplication_2])  # -> Geometry, Transform
nurbs = NurbsCurve(Vertices=move.Geometry, Degree=3, Periodic=False)  # -> Curve, Length, Domain
loft = Loft(
    Curves=flatten(nurbs.Curve),
    Options={Adjust=False, Closed=False, LoftEnds=0, LoftSimp=0, LoftType=0, Rebuild=10, Refit=0.01})
cap = CapHoles(Brep=loft)
volume = Volume(Geometry=cap)  # -> Volume, Centroid
project = Project(Geometry=volume.Centroid, Plane=PlaneXY(0, 0, 0))  # -> Geometry, Transform
vec2pt_2 = Vector2Pt(PointA=project.Geometry, PointB="{0, 0, 0}", Unitize=False)  # -> Vector, Length
move_2 = Move(Geometry=cap, Motion=vec2pt_2.Vector)  # -> Geometry, Transform
G = ClusterOutput(move_2.Geometry)
